# Grasshopper definition 003.gh (Grasshopper 1.0.7)
# plug-ins: Weaverbird, Kangaroo2 Components, Human, Pufferfish

number_slider = Slider(3, range=2..20)
multiplication = Multiplication(A=number_slider, B=2)
cylinder = Cylinder(Base=PlaneXY(0, 0, 0), Radius=Slider(5, range=2..20), Length=Slider(12, range=2..20))
addition = Addition(A=multiplication, B=1)
boolean = Boolean(True)
boolean_2 = Boolean(False)
divide_domain² = DivideDomain²(Domain=cylinder, UCount=Slider(20, range=2..20), VCount=addition)
duplicate_data = DuplicateData(Data=[boolean, boolean_2], Number=number_slider, Order=True)
isotrim = Isotrim(Surface=cylinder, Domain=divide_domain²)
merge = Merge(Data1=flatten(duplicate_data), Data2=boolean)
simple_mesh = SimpleMesh(Brep=isotrim)
dispatch = Dispatch(List=simple_mesh, DispatchPattern=merge)  # -> ListA, ListB
deconstruct_mesh = DeconstructMesh(Mesh=simplify(dispatch.ListA))  # -> Vertices, Faces, Colours, Normals
deconstruct_mesh_2 = DeconstructMesh(Mesh=simplify(dispatch.ListB))  # -> Vertices, Faces, Colours, Normals
list_item = ListItem(List=deconstruct_mesh_2.Vertices, Index=0, Wrap=True)  # -> Item, Item1, Item2, Item3
list_item_2 = ListItem(List=deconstruct_mesh.Vertices, Index=0, Wrap=True)  # -> Item, Item1, Item2, Item3
average = Average(Input=[list_item_2.Item1, list_item_2.Item])
average_2 = Average(Input=[list_item_2.Item3, list_item_2.Item2])
average_3 = Average(Input=[list_item.Item1, list_item.Item2])
average_4 = Average(Input=[list_item.Item, list_item.Item1])
average_5 = Average(Input=[list_item.Item2, list_item.Item3])
average_6 = Average(Input=[list_item.Item3, list_item.Item])
series = Series(Start=1, Step=1, Count="5")
addition_2 = Addition(A="5", B="1")
duplicate_data_2 = DuplicateData(Data="0", Number="5", Order=True)
addition_3 = Addition(A=series, B=1)
average_7 = Average(Input=[average, average_2])
_0 = Point(list_item.Item)
_5 = Point(average_3)
weave = Weave(Pattern=[0, 1, 2], Stream0=duplicate_data_2, Stream1=series, Stream2=addition_3, NullGaps=False)
_6 = Point(list_item.Item1)
_7 = Point(average_4)
_1 = Point(average_6)
_2 = Point(list_item.Item3)
_4 = Point(list_item.Item2)
weave_2 = Weave(Pattern=[0, 1, 2], Stream0=series, Stream1=addition_3, Stream2=duplicate_data_2, NullGaps=False)
_3 = Point(average_5)
_0_2 = Point(average_7)
_5_2 = Point(list_item_2.Item2)
_6_2 = Point(list_item_2.Item1)
_1_2 = Point(average)
_2_2 = Point(list_item_2.Item)
_4_2 = Point(average_2)
_3_2 = Point(list_item_2.Item3)
merge_2 = Merge(Data1=_0_2, Data2=_1_2, Data3=_2_2, Data4=_3_2, Data5=_4_2, Data6=_5_2, Data7=_6_2)  # -> simplify(Result)
merge_3 = Merge(Data1=_0, Data2=_1, Data3=_2, Data4=_3, Data5=_4, Data6=_5, Data7=_6, Data8=_7)
panel = Panel("""0
1
7
1
2
3
3
4
5
5
6
7
7
1
3
7
3
5""")
merge_4 = Merge(Data1=flatten(weave_2), Data2=addition_2, Data3="1", Data4="0")
merge_5 = Merge(Data1=flatten(weave), Data2="0", Data3=addition_2, Data4="1")
list_item_3 = ListItem(List=merge_2, Index=merge_4, Wrap=True)
list_item_4 = ListItem(List=merge_2, Index=merge_5, Wrap=True)
partition_list = PartitionList(List=panel, Size=3)
line = Line(StartPoint=list_item_4, EndPoint=list_item_3)  # -> simplify(Line)
list_item_5 = ListItem(List=partition_list, Index=0, Wrap=True)  # -> Item, Item1, Item2
partition_list_2 = PartitionList(List=line, Size=3)
merge_6 = Merge(Data1=list_item_5.Item1, Data2=list_item_5.Item2, Data3=list_item_5.Item)  # -> flatten(Result)
list_item_6 = ListItem(List=merge_3, Index=panel, Wrap=True)
list_item_7 = ListItem(List=merge_3, Index=merge_6, Wrap=True)
weaverbird_s_mesh_from_lines_weave_back = WeaverbirdsMeshFromLinesWeaveBack(Lines=partition_list_2, MaximumValence=4)  # -> simplify(Mesh)
line_2 = Line(StartPoint=list_item_6, EndPoint=list_item_7)
partition_list_3 = PartitionList(List=line_2, Size=3)
weaverbird_s_mesh_from_lines_weave_back_2 = WeaverbirdsMeshFromLinesWeaveBack(Lines=partition_list_3, MaximumValence=4)  # -> simplify(Mesh)
trim_tree = TrimTree(Tree=simplify(weaverbird_s_mesh_from_lines_weave_back), Depth=1)
number_slider_2 = Slider(0, range=0..180)
trim_tree_2 = TrimTree(Tree=simplify(weaverbird_s_mesh_from_lines_weave_back_2), Depth=1)
mesh_join = MeshJoin(Meshes=flatten(trim_tree))
mesh_join_2 = MeshJoin(Meshes=flatten(trim_tree_2))

list_item_8 = ListItem(Index=0, Wrap=True)  # -> Item, Item1, Item2, Item3, Item4, Item5
geometry = Geometry(list_item_8.Item)
geometry_2 = Geometry(list_item_8.Item1)
geometry_3 = Geometry(list_item_8.Item2)
geometry_4 = Geometry(list_item_8.Item3)
geometry_5 = Geometry(list_item_8.Item4)
geometry_6 = Geometry(list_item_8.Item5)

point = Point(flatten([_1_2, _2_2, _3_2, _4_2, _5_2, _6_2, _7, _0, _2, _3, _4, _6]))
point_2 = Point(flatten([_1, _0_2, _5]))
mesh_join_3 = MeshJoin(Meshes=[mesh_join_2, mesh_join])
cull_duplicates = CullDuplicates(Points=point, Tolerance=0.1, CullMode=3)  # -> Points, Indices, Valence
cull_duplicates_2 = CullDuplicates(Points=point_2, Tolerance=0.1, CullMode=3)  # -> Points, Indices, Valence
radians = Radians(Degrees=number_slider_2)
hingepoints = HingePoints(Mesh=mesh_join_3)  # -> _1, _2, _3, _4
mesh_naked_edges = MeshNakedEdges(Mesh=mesh_join_3)  # -> Naked, ResultBoolean
deconstruct = Deconstruct(Point=cull_duplicates.Points)  # -> XComponent, YComponent, ZComponent
deconstruct_2 = Deconstruct(Point=cull_duplicates_2.Points)  # -> XComponent, YComponent, ZComponent
list_item_9 = ListItem(List=hingepoints._1, Index=0, Wrap=True)
list_item_10 = ListItem(List=hingepoints._3, Index=0, Wrap=True)
list_item_11 = ListItem(List=hingepoints._4, Index=0, Wrap=True)
list_item_12 = ListItem(List=hingepoints._2, Index=0, Wrap=True)
construct_point = ConstructPoint(XCoordinate=0, YCoordinate=0, ZCoordinate=deconstruct.ZComponent)
construct_point_2 = ConstructPoint(XCoordinate=0, YCoordinate=0, ZCoordinate=deconstruct_2.ZComponent)
explode = Explode(Curve=mesh_naked_edges.Naked, Recursive=True)  # -> Segments, Vertices
volume = Volume(Geometry=cylinder)  # -> Volume, Centroid
number_slider_3 = Slider(21.3, range=0..30)
vector_2pt = Vector2Pt(PointA=cull_duplicates.Points, PointB=construct_point, Unitize=False)  # -> Vector, Length
vector_2pt_2 = Vector2Pt(PointA=cull_duplicates_2.Points, PointB=construct_point_2, Unitize=False)  # -> Vector, Length
vector_2pt_3 = Vector2Pt(PointA=explode.Vertices, PointB=volume.Centroid, Unitize=False)  # -> Vector, Length
multiplication_2 = Multiplication(A=number_slider_3, B=Slider(0, range=0..1))
amplitude = Amplitude(Vector=vector_2pt_3.Vector, Amplitude=Slider(1.5, range=0..10))
amplitude_2 = Amplitude(Vector=vector_2pt.Vector, Amplitude=multiplication_2)
amplitude_3 = Amplitude(Vector=vector_2pt_2.Vector, Amplitude=number_slider_3)
reverse = Reverse(Vector=amplitude_2)
nofoldthrough = NoFoldThrough(FoldStart=hingepoints._1, FoldEnd=hingepoints._2, Tip1=hingepoints._3, Tip2=hingepoints._4, Strength="100000")
load = Load(Point=graft(cull_duplicates_2.Points), ForceVector=graft(amplitude_3), Weighting=1)  # -> flatten(Unary)
load_2 = Load(Point=explode.Vertices, ForceVector=amplitude, Weighting=1)  # -> flatten(Unary)
floor = Floor(Strength="1000")
show = Show(G=mesh_join_3)
load_3 = Load(Point=graft(cull_duplicates.Points), ForceVector=graft(reverse), Weighting=1)  # -> flatten(Unary)
plastichinge = PlasticHinge(
    FoldStart=hingepoints._1,
    FoldEnd=hingepoints._2,
    Tip1=hingepoints._3,
    Tip2=hingepoints._4,
    RestAngle=number_slider_2,
    Limit="0.00001",
    Strength="1000")
edgelengths = EdgeLengths(Mesh=mesh_join_3, LengthFactor=1, Strength="1000")

merge_7 = Merge(
    Data1=show,
    Data2=plastichinge,
    Data3=floor,
    Data4=load,
    Data5=edgelengths,
    Data6=load_3,
    Data7=load_2,
    Data9=nofoldthrough)
solver = Solver(GoalObjects=merge_7, Reset=Button(), Threshold=1e-15, Tolerance=0.0001, On=Toggle(False))  # -> I, V, O

stream_filter = StreamFilter(Gate=Button(), Stream0=Slider(1, range=0..1), Stream1="0")

stepsolver = StepSolver(GoalObjects=merge_7, Tolerance=0.0001, Momentum=True, Damping=0.99, SubIterations=10, Animate=stream_filter)  # -> I, V, O
custom_preview = CustomPreview(
    Geometry=stepsolver.O,
    Material={diffuse=RGB(221, 160, 221), emission=RGB(66, 48, 66), shine=0.5, specular=RGB(255, 255, 255), transparency=0})

list_item_13 = ListItem(List=stepsolver.O, Index=0, Wrap=True)
bake_geometry = BakeGeometry(Bake=Button(), Geometry=list_item_13, DeleteOldBakes=False, PreserveTrees=False)
custom_preview_2 = CustomPreview(
    Geometry=solver.O,
    Material={diffuse=RGB(221, 160, 221), emission=RGB(66, 48, 66), shine=0.5, specular=RGB(255, 255, 255), transparency=0})
